# Grasshopper definition PCA_example_3d.gh (Grasshopper 0.9.76)
# plug-ins: Python Interpreter, GH_CPython

# 171031 @dantaeyoung https://github.com/dantaeyoung/GrasshopperArsenal
# mpg disp  hp drat    wt  qsec
# Mazda RX4         21.0  160 110 3.90 2.620 16.46
# Mazda RX4 Wag     21.0  160 110 3.90 2.875 17.02
# Datsun 710        22.8  108  93 3.85 2.320 18.61
# Hornet 4 Drive    21.4  258 110 3.08 3.215 19.44
# Hornet Sportabout 18.7  360 175 3.15 3.440 17.02
# Valiant           18.1  225 105 2.76 3.460 20.22
panel = Panel("""21.0,160,110,3.90,2.620,16.46
21.0,160,110,3.90,2.875,17.02
22.8,108,93,3.85,2.320,18.61
21.4,258,110,3.08,3.215,19.44
18.7,360,175,3.15,3.440,17.02
18.1,225,105,2.76,3.460,20.22""")
split = TextSplit(Text=panel, Separators=",")
panel_2 = Panel(split)

# ---- group: This is the Python code that uses numpy and matplotlib to do PCA.
principal_component_analysis = PrincipalComponentAnalysis(data=split)  # -> output, corrcoef, pca_y, pca_wt; inputs data: tree
#   port data: [required] - [type = int] - [default = None] Descripe your input here * bullet point. * bullet point
#   port output: indicate your output description here. refers to a new line.
# ---------- principal_component_analysis: Python ----------
import numpy as np
from matplotlib.mlab import PCA


from numpy import mean,cov,double,cumsum,dot,linalg,array,rank

def princomp(A):
     """ performs principal components analysis 
         (PCA) on the n-by-p data matrix A
         Rows of A correspond to observations, columns to variables. 

     Returns :  
      coeff :
        is a p-by-p matrix, each column containing coefficients 
        for one principal component.
      score : 
        the principal component scores; that is, the representation 
        of A in the principal component space. Rows of SCORE 
        correspond to observations, columns to components.
      latent : 
        a vector containing the eigenvalues 
        of the covariance matrix of A.
     """
     # computing eigenvalues and eigenvectors of covariance matrix
     M = (A-mean(A.T,axis=1)).T # subtract the mean (along columns)
     [latent,coeff] = linalg.eig(cov(M)) # attention:not always sorted
     score = dot(coeff.T,M) # projection of the data in the new space
     return coeff,score,latent


def raggedListToDataTree(raggedList):
    rl = raggedList
    result = DataTree[object]()
    for i in range(len(rl)):
        temp = []
        for j in range(len(rl[i])):
            temp.append(rl[i][j])
        path = GH_Path(i)
        result.AddRange(temp, path)
    return result

npdata = np.array(_data)
pca = PCA(npdata)

pca_y_ = pca.Y.tolist()

pca_wt_ = pca.Wt.tolist()

corrcoef = np.corrcoef(npdata)
corrcoef_ = np.nan_to_num(corrcoef).tolist()
# ---------- end principal_component_analysis ----------

# ---- group: this is a temporary hack, designed to process the output from the GH_CPython as GH trees.
ghcpy_to_datatree = PythonScript(input=principal_component_analysis.pca_y)  # -> output
# ---------- ghcpy_to_datatree: Python ----------
import rhinoscriptsyntax as rs

import Rhino.Geometry as rg
from clr import AddReference as addr
addr("Grasshopper")

from System import Object
from Grasshopper import DataTree
from Grasshopper.Kernel.Data import GH_Path

def raggedListToDataTree(raggedList):
    rl = raggedList
    result = DataTree[object]()
    for i in range(len(rl)):
        temp = []
        for j in range(len(rl[i])):
            temp.append(rl[i][j])
        #print i, " - ",temp
        path = GH_Path(i)
        result.AddRange(temp, path)
    return result

def dataTreeToList(aTree):
    theList = []
    for i in range(aTree.BranchCount ):
        thisListPart = []
        thisBranch = aTree.Branch(i)
        for j in range(len(thisBranch)):
            thisListPart.append( thisBranch[j] )
        theList.append(thisListPart)
    return theList

print _input
eval_input = eval(str(_input)) # this is so hacky
output_ =  raggedListToDataTree(eval_input)
# ---------- end ghcpy_to_datatree ----------

# ---- group: Plot as 3d points
item = ListItem(List=ghcpy_to_datatree, Index=0, Wrap=True)  # -> Item, Item1, Item2
pt = ConstructPoint(XCoordinate=item.Item, YCoordinate=item.Item1, ZCoordinate=item.Item2)

# ---- group: Or alternately, as 2d
item_2 = ListItem(List=ghcpy_to_datatree, Index=0, Wrap=True)  # -> Item, Item1, Item2
pt_2 = ConstructPoint(XCoordinate=item_2.Item, YCoordinate=item_2.Item1, ZCoordinate=0)

# ----
panel_3 = Panel(ghcpy_to_datatree)

# ---- group: Display
panel_4 = Panel("""Mazda RX4
Mazda RX4 Wag     
Datsun 710        
Hornet 4 Drive    
Hornet Sportabout 
Valiant          """)
Y = UnitY(Factor=Slider(0.1, range=0..1))
dots = DotDisplay(Point=pt, Colour=RGB(0, 0, 0), Size=Slider(0.061, range=0..0.2))
move = Move(Geometry=pt, Motion=Y)  # -> Geometry, Transform
tag = TextTag(Location=move.Geometry, Text=graft(panel_4))
