# Grasshopper definition KeyboardAndMouseTools.gh (Grasshopper 1.0.7)
# plug-ins: InteracTool, Human

# Other Inputs - Keyboard and Mouse
# Dan Taeyoung (@dantaeyoung) : http://github.com/provolot/GrasshopperArsenal
libraries_this_script_uses = Panel("""Human
InteracTool""")
number_slider = Slider(6.92, range=0..10)  # disabled
number_slider_2 = Slider(7.66, range=0..10)  # disabled
# Data Dam / Stream tools
number_slider_3 = Slider(5.66, range=0..10)  # disabled
panel = Panel("1")  # disabled
panel_2 = Panel("""1
22
333
Example Geometry""")  # disabled
toggle = BooleanToggle(False)  # disabled
mouse = MouseEvent(Start=panel)  # -> Line, Point, Button, Double, SPoint; disabled
dam = DataDam(DataA=number_slider_2, BufferDelay=5000000, BufferMode=2)  # disabled
dam_2 = DataDam(DataA=number_slider, BufferDelay=5000000, BufferMode=2)  # disabled
panel_3 = Panel(number_slider_2)  # disabled

# ---- group: "Stream Filter" can operate like a switch
filter = StreamFilter(Gate=toggle, Stream1=panel_2)  # disabled

# ----
panel_4 = Panel(number_slider)  # disabled

# ---- group: Data Dam can help slow down user input. This is helpful when making a script.
dam_3 = DataDam(DataA=mouse.Point, BufferDelay=2500000, BufferMode=2)  # disabled

# ---- group: This component is called "Data Dam"
dam_4 = DataDam(DataA=number_slider_3, BufferDelay=10000000, BufferMode=2)  # disabled

# ----
panel_5 = Panel(dam)  # disabled
panel_6 = Panel(dam_2)  # disabled
swatch = ColourSwatch(SwatchColor=RGB(112, 108, 108))  # disabled
sph = Sphere(Base=dam_3, Radius=1)  # disabled
panel_7 = Panel(filter)  # disabled

# ---- group: This setup can help detect "When data is changing".
equals = Equality(FirstNumber=dam, SecondNumber=number_slider_2)  # -> Equality, Inequality; disabled

equals_2 = Equality(FirstNumber=dam_2, SecondNumber=number_slider)  # -> Equality, Inequality; disabled

# ----
preview = CustomPreview(Geometry=sph, Material=swatch)  # disabled
panel_8 = Panel(dam_4)  # disabled
filter_2 = StreamFilter(Gate=equals_2.Inequality, Stream1=number_slider)  # disabled
is_data_changing = Panel(equals.Inequality)  # disabled
data_only_when_changing = Panel(filter_2)  # disabled
panel_9 = Panel("2")  # disabled
toggle_2 = BooleanToggle(True)  # disabled
number_slider_4 = Slider(33, range=0..100)  # disabled
number_slider_5 = Slider(33, range=0..100)  # disabled
mouse_2 = MouseEvent(Start=panel_9)  # -> Line, Point, Button, Double, SPoint; disabled
toggle_3 = BooleanToggle(True)  # disabled
timer = Timer(TimerInterval=100, Target=selobj)  # disabled
timer_2 = Timer(TimerInterval=100, Target=selobj_2)  # disabled
number_slider_6 = Slider(33, range=0..100)  # disabled
bool = Boolean(mouse_2.Point)  # disabled

# ---- group: This selects objects that you've selected with the mouse in Rhino!
# Mouse Input
selobj = ObjectsBySelection(Reset=toggle_2, LiveMode=False)  # disabled

# ----
selobj_2 = ObjectsBySelection(Reset=toggle_3, LiveMode=False)  # disabled
Z = UnitZ(Factor=number_slider_5)  # disabled
Z_2 = UnitZ(Factor=number_slider_4)  # disabled

# ---- group: If we use mouse clicks to generate a "True" value, everything updates only when we click.
dam_5 = DataDam(DataA=bool, BufferDelay=2500000, BufferMode=2)  # disabled

# ----
selobj_3 = ObjectsBySelection(Reset=dam_5, LiveMode=False)  # disabled
swatch_2 = ColourSwatch(SwatchColor=RGB(110, 235, 137))  # disabled
swatch_3 = ColourSwatch(SwatchColor=RGB(110, 235, 137))  # disabled
Z_3 = UnitZ(Factor=number_slider_6)  # disabled
extr = Extrude(Base=selobj_2, Direction=Z)  # disabled
extr_2 = Extrude(Base=selobj, Direction=Z_2)  # disabled
panel_10 = Panel(selobj_2)  # disabled
panel_11 = Panel(selobj)  # disabled
swatch_4 = ColourSwatch(SwatchColor=RGB(110, 235, 137))  # disabled
extr_3 = Extrude(Base=selobj_3, Direction=Z_3)  # disabled
preview_2 = CustomPreview(Geometry=extr_2, Material=swatch_2)  # disabled

# ---- group: Having a Timer upstream means that everything downstream refreshes constantly.
dam_6 = DataDam(DataA=extr, BufferDelay=2500000, BufferMode=2)  # disabled

# ----
# Notice how this is only updating when we click!
# Now everything downstream won't refresh constantly.
panel_12 = Panel(dam_5)  # disabled
preview_3 = CustomPreview(Geometry=extr_3, Material=swatch_4)  # disabled
dam_7 = DataDam(DataA=extr_3, BufferDelay=2500000, BufferMode=2)  # disabled
preview_4 = CustomPreview(Geometry=dam_6, Material=swatch_3)  # disabled
number_slider_7 = Slider(1, range=0..4)  # disabled
# Keyboard Input
number_slider_8 = Slider(1, range=0..4)  # disabled
panel_13 = Panel("""a
b
c
d
e
f""")  # disabled
keyboard = KeyBoardEvent(Start=number_slider_7, Keys=panel_13)  # -> Current, Pressed, Toggled; disabled
keyboard_2 = KeyBoardEvent(Start=number_slider_8)  # -> Current, Pressed, Toggled; disabled
panel_14 = Panel(keyboard_2.Current)  # disabled
panel_15 = Panel(keyboard.Pressed)  # disabled
panel_16 = Panel(keyboard.Toggled)  # disabled
panel_17 = Panel(keyboard.Current)  # disabled
dispatch = Dispatch(List=panel_13, DispatchPattern=panel_15)  # -> ListA, ListB; disabled
dispatch_2 = Dispatch(List=panel_13, DispatchPattern=panel_16)  # -> ListA, ListB; disabled
panel_18 = Panel(dispatch.ListA)  # disabled
panel_19 = Panel(dispatch_2.ListA)  # disabled
panel_20 = Panel("2")  # disabled
panel_21 = Panel("2")  # disabled
mouse_3 = MouseEvent(Start=panel_20)  # -> Line, Point, Button, Double, SPoint; disabled
# Object Attributes
mouse_4 = MouseEvent(Start=panel_21)  # -> Line, Point, Button, Double, SPoint; disabled
# We can display all of the geometry names
pipeline = GeometryPipeline(
    GroupByLayer=False,
    GroupByType=False,
    IncludeHidden=True,
    IncludeLocked=True,
    LayerFilter="*",
    NameFilter="*",
    SublayerFiltering=True,
    TypeFilter=4)  # disabled
panel_22 = Panel("HELLO123")  # disabled
bool_2 = Boolean(mouse_3.Point)  # disabled
bool_3 = Boolean(mouse_4.Point)  # disabled
# These two components help you set
# the 'name' of a referenced Rhino object.
# This is one way to store user input
# from a keyboard into a Rhino object.
createatts = CreateAttributes(Name=panel_22, enableFullPath=False)  # disabled
dam_8 = DataDam(DataA=bool_2, BufferDelay=2500000, BufferMode=2)  # disabled
dam_9 = DataDam(DataA=bool_3, BufferDelay=2500000, BufferMode=2)  # disabled

# ---- group: "PointOnCurve" helps us quickly get the midpoint of lines
curvepoint = PointOnCurve(pipeline, parameter=0.5)  # disabled

# ----
objatts = ObjectAttributes(ObjectOrAttributes=pipeline)  # -> Name, LayerName, LayerFullPath, Color, MaterialName, LinetypeName, GroupIndices, PlotWeight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; disabled
# This component helps you retrieve attributes
# from a referenced Rhino object.
selobj_4 = ObjectsBySelection(Reset=dam_8, LiveMode=False)  # disabled
selobj_5 = ObjectsBySelection(Reset=dam_9, LiveMode=False)  # disabled
panel_23 = Panel(objatts.Name)  # disabled
objatts_2 = ObjectAttributes(ObjectOrAttributes=selobj_4)  # -> Name, LayerName, LayerFullPath, Color, MaterialName, LinetypeName, GroupIndices, PlotWeight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; disabled
swatch_5 = ColourSwatch(SwatchColor=RGB(255, 255, 255))  # disabled
modatts = ModifyObjectAttributes(Objects=selobj_5, Attributes=createatts)  # disabled

# ---- group: This generates 'text tags'
tag = TextTag(Location=curvepoint, Text=panel_23, Colour=swatch_5)  # disabled

# ----
panel_24 = Panel(objatts_2.Name)  # disabled
panel_25 = Panel(objatts_2.LayerName)  # disabled
pipeline_2 = GeometryPipeline(
    GroupByLayer=False,
    GroupByType=False,
    IncludeHidden=True,
    IncludeLocked=True,
    LayerFilter="*",
    NameFilter="*",
    SublayerFiltering=True,
    TypeFilter=1073741852)  # disabled
getroughmidpoint = GetRoughMidpoint(geo=pipeline_2)  # disabled
number_slider_9 = Slider(1, range=0..4)  # disabled
# This sets geometry names
panel_26 = Panel("2")  # disabled
panel_27 = Panel("""a
b
c
d
e
f""")  # disabled
# And this changes the geometry based on the name
objatts_3 = ObjectAttributes(ObjectOrAttributes=pipeline_2)  # -> Name, LayerName, LayerFullPath, Color, MaterialName, LinetypeName, GroupIndices, PlotWeight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; disabled
# WallMaker with Keyboard Control
mouse_5 = MouseEvent(Start=panel_26)  # -> Line, Point, Button, Double, SPoint; disabled
bool_4 = Boolean(mouse_5.Point)  # disabled
keyboard_3 = KeyBoardEvent(Start=number_slider_9, Keys=panel_27)  # -> Current, Pressed, Toggled; disabled
swatch_6 = ColourSwatch(SwatchColor=RGB(255, 255, 255))  # disabled
dam_10 = DataDam(DataA=bool_4, BufferDelay=2500000, BufferMode=2)  # disabled
dispatch_3 = Dispatch(List=panel_27, DispatchPattern=keyboard_3.Pressed)  # -> ListA, ListB; disabled
all_geometry_names = Data(objatts_3.Name)  # disabled
tag_2 = TextTag(Location=getroughmidpoint, Text=objatts_3.Name, Colour=swatch_6)  # disabled

# ---- group: This component will find all the currently selected geometry.
selobj_6 = ObjectsBySelection(Reset=dam_10, LiveMode=False)  # disabled

# ----
all_geometry = Geometry(pipeline_2)  # disabled

# ---- group: Is the first item null? or: do we have no input?
item = ListItem(List=dispatch_3.ListA, Index=0, Wrap=True)  # disabled
null = NullItem(Item=item)  # -> NullFlags, InvalidFlags, Description; disabled

# ----
createatts_2 = CreateAttributes(Name=dispatch_3.ListA, enableFullPath=False)  # disabled
geo = Geometry(selobj_6)  # disabled
all_geometry_names_2 = Data(all_geometry_names)  # disabled
panel_28 = Panel(null.NullFlags)  # disabled
panel_29 = Panel("c")  # disabled

# ---- group: Only pass data on if we've just pressed a key
filter_3 = StreamFilter(Gate=null.NullFlags, Stream0=createatts_2)  # disabled

# ----
all_geometry_names_3 = Data(all_geometry_names)  # disabled
# This creates geometry for objects with name "c"
all_geometry_2 = Geometry(all_geometry)  # disabled
panel_30 = Panel("a")  # disabled
all_geometry_names_4 = Data(all_geometry_names)  # disabled
# This creates geometry for objects with name "a"
all_geometry_3 = Geometry(all_geometry)  # disabled
panel_31 = Panel("b")  # disabled
# This creates geometry for objects with name "b"
all_geometry_4 = Geometry(all_geometry)  # disabled
tmatch = MatchText(Text=all_geometry_names_2, Pattern=panel_29, Case=True)  # disabled
number_slider_10 = Slider(8, range=0..10)  # disabled
modatts_2 = ModifyObjectAttributes(Objects=geo, Attributes=filter_3)  # disabled
tmatch_2 = MatchText(Text=all_geometry_names_3, Pattern=panel_30, RegEx=panel_30, Case=True)  # disabled
number_slider_11 = Slider(6, range=0..10)  # disabled
number_slider_12 = Slider(1, range=0..1)  # disabled
tmatch_3 = MatchText(Text=all_geometry_names_4, Pattern=panel_31, Case=True)  # disabled
dispatch_4 = Dispatch(List=all_geometry_2, DispatchPattern=tmatch)  # -> ListA, ListB; disabled
number_slider_13 = Slider(20, range=0..30)  # disabled
number_slider_14 = Slider(20, range=0..30)  # disabled
dispatch_5 = Dispatch(List=all_geometry_3, DispatchPattern=tmatch_2)  # -> ListA, ListB; disabled
divlength = DivideLength(Curve=dispatch_4.ListA, Length=number_slider_10)  # -> Points, Tangents, Parameters; disabled
dispatch_6 = Dispatch(List=all_geometry_4, DispatchPattern=tmatch_3)  # -> ListA, ListB; disabled
Z_4 = UnitZ(Factor=number_slider_11)  # disabled
polygon = Polygon(Plane=divlength.Points, Radius=number_slider_12, Segments=6, FilletRadius=0)  # -> Polygon, Length; disabled
Z_5 = UnitZ(Factor=number_slider_13)  # disabled
extr_4 = Extrude(Base=dispatch_5.ListA, Direction=Z_4)  # disabled
Z_6 = UnitZ(Factor=number_slider_14)  # disabled
swatch_7 = ColourSwatch(SwatchColor=RGB(115, 240, 231))  # disabled
extr_5 = Extrude(Base=dispatch_6.ListA, Direction=Z_5)  # disabled
swatch_8 = ColourSwatch(SwatchColor=RGB(130, 122, 207))  # disabled
extr_6 = Extrude(Base=polygon.Polygon, Direction=Z_6)  # disabled
swatch_9 = ColourSwatch(SwatchColor=RGB(114, 93, 145))  # disabled
preview_5 = CustomPreview(Geometry=extr_4, Material=swatch_7)  # disabled
preview_6 = CustomPreview(Geometry=extr_5, Material=swatch_8)  # disabled
cap = CapHoles(Brep=extr_6)  # disabled
preview_7 = CustomPreview(Geometry=cap, Material=swatch_9)  # disabled

# ==== cluster GetRoughMidpoint
geo = ClusterInput()
number_slider = Slider(0.5, range=0..1)
geo_2 = Geometry(geo)
bbox = BoundingBox(Content=geo_2, Plane=PlaneXY(0, 0, 0))  # -> Box, Box_2
crv = Curve(geo_2)
srf = Surface(geo_2)
pt = ConstructPoint(XCoordinate=number_slider, YCoordinate=number_slider, ZCoordinate=0)
curvepoint = PointOnCurve(crv, parameter=0.5)
volume = Volume(Geometry=bbox.Box)  # -> Volume, Centroid
evalsrf = EvaluateSurface(Surface=reparameterize(srf), Point=pt)  # -> Point, Normal, UDirection, VDirection, Frame
combine = CombineData(Input0=evalsrf.Point, Input1=curvepoint, Input2=volume.Centroid)  # -> Result, Index
roughmidpt = Point(combine.Result)
roughmidpt_2 = ClusterOutput(roughmidpt)
