# Grasshopper definition LispHopper.ghx (Grasshopper 0.9.76)
# plug-ins: Python Interpreter, Human, GH_CPython

# LispHopper?
# Hy-gh (pronounced 'hygge')?
# 
# 170821  @dantaeyoung https://github.com/dantaeyoung/GrasshopperArsenal
# Using Hy (https://github.com/hylang/hy)
path = FilePath("C:\Users\provolot\Desktop\hytest.hy")
panel = Panel(path)
file = ReadFile(F=panel, PerLineParse=False)  # -> C
#   port F: Uri of file to read
# ---------- file: VB line parser ----------
    action = GH_LineParserAction.Include
    Return line

    'Parse the line and return some data that represents the line.
    'If the line cannot be parsed, you can return Nothing and
    'assign a different action.
    'The default implementation is to just return the line itself.
    'If you return types that implement IGH_Goo, this component
    'will work substantially faster.
# ---------- end file ----------
panel_2 = Panel(file)
# Hy -> Python from file
gh_cpython = GH_CPython(hyPath=panel)  # -> pycode
# ---------- gh_cpython: Python ----------
# -*- coding: utf-8 -*-

from hy.cmdline import pretty_error
from hy.importer import (import_file_to_ast, import_buffer_to_ast)
import astor.codegen

module_name = "<STDIN>"

def file_to_pycode(filename):
    _ast = pretty_error(import_file_to_ast, filename, module_name)
    pycode = astor.codegen.to_source(_ast)
    return pycode

def text_to_pycode(stdin_text):
    _ast = pretty_error(import_buffer_to_ast, stdin_text, module_name)
    pycode = astor.codegen.to_source(_ast)
    return pycode

####


if _hyPath:
    pycode_ = file_to_pycode(_hyPath)
else:
    pycode_ = text_to_pycode(_hyCode)

print pycode_
# ---------- end gh_cpython ----------
# Hy -> Python from text
gh_cpython_2 = GH_CPython(hyCode=panel_2)  # -> out, pycode
# ---------- gh_cpython_2: Python ----------
# -*- coding: utf-8 -*-

from hy.cmdline import pretty_error
from hy.importer import (import_file_to_ast, import_buffer_to_ast)
import astor.codegen

module_name = "<STDIN>"

def clean_of_hy(pycode):
    import re

    def not_matches_hylib(line):
        return False if re.match(r"from hy", line) else True

    return "\n".join(filter(not_matches_hylib, pycode.split("\n")))
    

def file_to_pycode(filename):
    _ast = pretty_error(import_file_to_ast, filename, module_name)
    pycode = astor.codegen.to_source(_ast)
    return pycode
    return clean_of_hy(pycode)
    
def text_to_pycode(stdin_text):
    _ast = pretty_error(import_buffer_to_ast, stdin_text, module_name)
    pycode = astor.codegen.to_source(_ast)
    return pycode
    return clean_of_hy(pycode)
    

####


if _hyPath:
    pycode_ = file_to_pycode(_hyPath)
else:
    pycode_ = text_to_pycode(_hyCode)
# ---------- end gh_cpython_2 ----------
panel_3 = Panel(gh_cpython)
# Add library import and GH Data tree output
panel_4 = Panel("""def list_to_tree(input, none_and_holes=False, base_path=[0]):
    \"\"\"Transforms nestings of lists or tuples to a Grasshopper DataTree\"\"\"
    from Grasshopper import DataTree as Tree
    from Grasshopper.Kernel.Data import GH_Path as Path
    from System import Array
    def process_one_item(input,tree,track):
        path = Path(Array[int](track))
        if len(input) == 0 and none_and_holes: tree.EnsurePath(path); return
        for i,item in enumerate(input):
            if hasattr(item, '__iter__'): #if list or tuple
                track.append(i); process_one_item(item,tree,track); track.pop()
            else:
                if none_and_holes: tree.Insert(item,path,i)
                elif item is not None: tree.Add(item,path)
    tree = Tree[object]()
    if input is not None: process_one_item(input,tree,base_path[:]); return tree
    

result_ = list_to_tree(result_)""")
panel_5 = Panel("""## MAKE LIBRARIES IMPORTABLE ##
import sys, os
libraryPath = os.path.dirname(sys.path[0]) + "\_LIBRARIES"
if not libraryPath in sys.path:
    sys.path.append(libraryPath)
################################""")
# Execute Hy->Python code in IronPython
concat = Concatenate(FragmentC=panel_5, FragmentA=gh_cpython_2.pycode, FragmentB=panel_4)
python = PythonScript(Code=concat)  # -> Out, Result_
data = Data(python.Result_)

# ---- group: Word wrap screen output
md_slider = MDSlider(
    slider_value=Point(0.6214737056, 0.7346970395, 0.5),
    SliderMode=0,
    x_domain=Domain(-100, 100),
    y_domain=Domain(-100, 100),
    z_domain=Domain(0, 1))
wordwrap = WordWrap(T=python.Out, S=Slider(51, range=0..100))
texttoscreen = RenderTextToScreen(
    Text=wordwrap,
    Location=md_slider,
    Size=12,
    Color=ColourSwatch(SwatchColor=RGB(43, 44, 151)),
    Font="Courier New",
    m_scWithvp=False)

# ----
panel_6 = Panel(python.Out)
preview = CustomPreview(Geometry=data, Shader=ColourSwatch(SwatchColor=RGB(83, 93, 255)))

# ==== cluster WordWrap
T = ClusterInput()
join = TextJoin(Text=T)
S = ClusterInput()
chars = Characters(Text=join)  # -> Result, Unicode
chars_2 = Characters(Text=T)  # -> Result, Unicode
partition = PartitionList(List=chars_2.Result, Size=S)
join_2 = TextJoin(Text=partition)
trim = TrimTree(Tree=join_2, Depth=1)
join_3 = TextJoin(Text=trim)  # -> flatten(Result)
join_4 = TextJoin(Text=join_3)
panel = Panel(join_4)
R = ClusterOutput(join_4)
