# Grasshopper definition TrackMouse.ghx (Grasshopper 0.9.76)
# plug-ins: Python Interpreter, LunchBox, Firefly.Core

toggle = BooleanToggle(False)
timer = Timer(TimerInterval=20, Target=[python, timerlocker])  # disabled
timerlocker = TimerLocker(EnableTimers=toggle)  # inputs EnableTimers: Boolean
# ---------- timerlocker: C# ----------
foreach(IGH_DocumentObject obj in GrasshopperDocument.Objects) { //for all objs in GH doc
      
      //Try to cast the object to a GH_Timer
      if(obj is Grasshopper.Kernel.Special.GH_Timer) {
        Grasshopper.Kernel.Special.GH_Timer timer = obj as Grasshopper.Kernel.Special.GH_Timer;
        if (timer.Targets.Contains(this.Component.InstanceGuid)) {
          
          if(!EnableTimers) { timer.Locked = true; }
          else { timer.Locked = false; }
        }
      }
    }
# ---------- end timerlocker ----------
excelread = ExcelReader(ReadToggle=False, Worksheet=1, Column=1, RowStart=1, RowEnd=10)  # -> Exceptions, ExcelData
python = PythonScript(toggle=toggle, ViewportName="Perspective")  # -> out, screencoords, viewportcoords, worlddirection, viewportplane
# ---------- python: Python ----------
import System
import Rhino
import scriptcontext
import System.Guid
"""
 Dim Point1 As  System.Drawing.Point = System.Windows.Forms.Cursor.Position
    Dim point2 As  System.Drawing.Point

    point2 = doc.Views.ActiveView.ScreenToClient(Point1)

    screenCoordinates = point1 ' doc.Views.ActiveView.ActiveViewport.ClientToWorld(point2)
    ViewportCoordinates = Point2

    WorldDirection = doc.Views.ActiveView.ActiveViewport.ClientToWorld(point2)
    ViewportConstructionPlane = doc.Views.ActiveView.ActiveViewport.ConstructionPlane()
"""
"""
            screencoords = System.Windows.Forms.Control.MousePosition
            viewportcoords = scriptcontext.doc.Views.ActiveView.ScreenToClient(screencoords)
            worlddirection = scriptcontext.doc.Views.ActiveView.ActiveViewport.ClientToWorld(viewportcoords)
            viewportplane = scriptcontext.doc.Views.ActiveView. ActiveViewport.ConstructionPlane()

"""
if toggle:
    for thisview in scriptcontext.doc.Views:
        if(ViewportName == thisview.ActiveViewport.Name) :
                
            screencoords = System.Windows.Forms.Control.MousePosition
            
            viewportcoords = thisview.ScreenToClient(screencoords)
            worlddirection = thisview.ActiveViewport.ClientToWorld(viewportcoords)
            viewportplane = thisview.ActiveViewport.ConstructionPlane()
# ---------- end python ----------
plx = LinePlane(Line=python.worlddirection, Plane=python.viewportplane)  # -> Point, ParamL, ParamP
log = DataLog(IncomingData=plx.Point, ResetLog=Button(), StartRecording=True, WrapValues=False, RecordingLength=0)
panel = Panel(log)
geo = Geometry(log)
